# Grasshopper definition PLC_CommTest_Final_Test.gh (Grasshopper 1.0.7)
# plug-ins: gHowl

udp发送验证码端口 = Panel("8849")

plc端口 = Panel("12346")
本机回送地址 = Panel("127.0.0.1")
plc_ip地址 = Panel("192.168.244.133")
udp接收数据端口 = Panel("8971")
生成校验码 = GhPythonScript(send=Button())  # -> out, data
# ---------- 生成校验码: Python ----------
__author__ = "Qi"
__version__ = "2020.04.30"

import os
import thread
import time
import scriptcontext as sc

sc.sticky['data'] = str(int(time.time()))[-4:]
if send:
    d = str(int(time.time()))[-4:]
    sc.sticky['data'] = d
data = sc.sticky['data']
# ---------- end 生成校验码 ----------
# 启动外部通讯服务程序
satrtplccomm = GhPythonScript(start=Button(), ghPort_s=udp接收数据端口, ghPort_r=udp发送验证码端口, plcAddr=plc_ip地址, plcPort=plc端口)  # -> out, a
# ---------- satrtplccomm: Python ----------
__author__ = "Qi"
__version__ = "2020.04.29"

import rhinoscriptsyntax as rs
import os
import thread
import time
import socket
        
def work(command):
    os.system(command)
    
ga = "127.0.0.1"
gp_s = int(ghPort_s)
gp_r = int(ghPort_r)
ra = plcAddr
rp = int(plcPort)

if start:
#    exe_path = os.path.join(os.path.expanduser('~'),"E:\\01大界相关内容\\KUKA_Robots\\pyPLC\\src\\PLC_TCP2GH_UDP.py")
#    command_py = "python %s -ga %s -gp_r %d -gp_s %d -pa %s -pp %d"%(exe_path,ga,gp_r, gp_s, ra, rp)
    exe_path = os.path.join(os.path.expanduser('~'),"AppData\Roaming\Grasshopper\Libraries\PLC_TCP2GH_UDP")
    command_py = "%s -ga %s -gp_r %d -gp_s %d -pa %s -pp %d"%(exe_path,ga,gp_r, gp_s, ra, rp)
    thread.start_new_thread(work,(command_py,)) # 开启多线程，防止拥堵
#    time.sleep(2) # 等待两秒，确保服务器开启
# ---------- end satrtplccomm ----------
# 发送验证码数据
udp = UDPSender(Address=本机回送地址, Port=udp发送验证码端口, Pattern=0, Data=生成校验码.data)
panel = Panel(生成校验码.data)

# ----
# 接收红外线数据
udp_2 = UDPReceiver(Address=本机回送地址, Port=udp接收数据端口, Pattern=0)  # -> Info, Data

panel_2 = Panel(udp_2.Data)
